# Grasshopper definition Tools Definition Example.gh (Grasshopper 1.0.7)

# ----
# Cross Lap Ortho Clamp - CL1
# The clamp type. Identifyable id name.
# Mesh Geometry of the parallel gripper. Base Mesh is attached to the robot (e.g. gripper body, spacer, quick changer)
# Geometry of the Left Body (between jaw and base) modeled at closed state, this part opens towards -neg Y direction as the gripper attach clamp to timber.
# Geometry of the Right Body modeled at closed state, this part opens towards +pos Y direction.
# Geometry of the Left Clamp Jaw modeled at closed state, this jaw open towards +pos Z direction.
# Geometry of the Right Clamp Jaw modeled at closed state, this jaw open towards +pos Z direction.
# Gripper (attach clamp to timber) operation distance limit of each jaw.
# Min = Closed Position
# Max = Open Position
# Clamp (joint closure) operation distance limit of each jaw.
# Min = Closed Position
# Max = Open Position
# Tool Coordinate Frame (TCF) where the clamp is attached to the joint, in relation to T0CF
# Position where the robot (T0CF) needs to reach before picking up tool during tool change . (in relation to T0CF)
# Location (frame) where the tool (TCF) is stored (in WCF) during fabrication
# Vector for gripper to approach beam
# Vector for robot to detach the clamp after joint is assembled. (in relation to T0CF)
xy = XYPlane(Origin=Point(0, 0, 0))
geo = Geometry(<brep referenced from the Rhino model>)
geo_2 = Geometry(<brep referenced from the Rhino model>)
geo_3 = Geometry(<brep referenced from the Rhino model>)
min_closed_position_typ_0 = Slider(0, range=0..200)
max_open_position = Slider(20, range=0..200)
min_closed_position_typ_0_2 = Slider(0, range=0..200)
max_open_position_2 = Slider(120, range=0..200)
pt = Point(<point referenced from the Rhino model>)
pt_2 = Point(<point referenced from the Rhino model>)
geo_4 = Geometry(<brep referenced from the Rhino model>)
geo_5 = Geometry(<brep referenced from the Rhino model>)
xy_2 = XYPlane(Origin=pt_2)
xy_3 = XYPlane(Origin=pt)
mesh = Mesh(geo_4)
mesh_2 = Mesh(geo_3)
mesh_3 = Mesh(geo_5)
mesh_4 = Mesh(geo)
mesh_5 = Mesh(geo_2)
vec = Vector("{0,0,-180}")
vec_2 = Vector("{-120,0,-5}")
Z = UnitZ(Factor=Slider(105, range=0..1000))
create_clamp = GhPythonScript(
    type_name="CL1",
    base_mesh=mesh_4,
    l_body_mesh=mesh_5,
    r_body_mesh=mesh,
    l_jaw_mesh=mesh_2,
    r_jaw_mesh=mesh_3,
    gripper_jaw_position_min=min_closed_position_typ_0,
    gripper_jaw_position_max=max_open_position,
    clamp_jaw_position_min=min_closed_position_typ_0_2,
    clamp_jaw_position_max=max_open_position_2,
    tool_coordinate_frame=xy_3,
    tool_pick_up_frame=xy_2,
    tool_storage_frame=xy,
    approach_vector=Z,
    detachretract1_vector=vec_2,
    detachretract2_vector=vec)  # -> out, visual, robot_model; inputs base_mesh: Mesh, l_body_mesh: Mesh, r_body_mesh: Mesh, l_jaw_mesh: Mesh, r_jaw_mesh: Mesh, tool_coordinate_frame: Plane, tool_pick_up_frame: Plane, tool_storage_frame: Plane, approach_vector: Vector3d, detachretract1_vector: Vector3d, detachretract2_vector: Vector3d
# ---------- create_clamp: Python ----------
#from compas_ghpython import unload_modules
#unload_modules("integral_timber_joints")

from compas.geometry import Frame
from compas_rhino.geometry import RhinoPlane, RhinoMesh, RhinoVector
from integral_timber_joints.tools import Lap90ClampFactory

from compas_ghpython.helpers import mesh_draw

tool_coordinate_frame = RhinoPlane.from_geometry(tool_coordinate_frame).to_compas()
tool_pick_up_frame = RhinoPlane.from_geometry(tool_pick_up_frame).to_compas()
tool_storage_frame = RhinoPlane.from_geometry(tool_storage_frame).to_compas()
mesh_gripper_base = RhinoMesh.from_geometry(base_mesh).to_compas()
mesh_gripper_jaw_l = RhinoMesh.from_geometry(l_body_mesh).to_compas()
mesh_gripper_jaw_r = RhinoMesh.from_geometry(r_body_mesh).to_compas()
mesh_clamp_jaw_l = RhinoMesh.from_geometry(l_jaw_mesh).to_compas()
mesh_clamp_jaw_r = RhinoMesh.from_geometry(r_jaw_mesh).to_compas()
approach_vector = RhinoVector.from_geometry(approach_vector).to_compas()
detachretract1_vector = RhinoVector.from_geometry(detachretract1_vector).to_compas()
detachretract2_vector = RhinoVector.from_geometry(detachretract2_vector).to_compas()

robot_model = Lap90ClampFactory(
    None,
    type_name,
    gripper_jaw_position_min,
    gripper_jaw_position_max,
    clamp_jaw_position_min,
    clamp_jaw_position_max,
    tool_coordinate_frame = tool_coordinate_frame,
    tool_pick_up_frame = tool_pick_up_frame,
    tool_storage_frame = tool_storage_frame,
    mesh_gripper_base = mesh_gripper_base,
    mesh_gripper_jaw_l = mesh_gripper_jaw_l,
    mesh_gripper_jaw_r = mesh_gripper_jaw_r,
    mesh_clamp_jaw_l = mesh_clamp_jaw_l,
    mesh_clamp_jaw_r = mesh_clamp_jaw_r,
    approach_vector = approach_vector,
    detachretract1_vector = detachretract1_vector,
    detachretract2_vector = detachretract2_vector,
    )
# ---------- end create_clamp ----------

# ----
# Development Tools
# Reload Python Modules (if Module Code is Changed)
python_module_to_reload = Panel("""compas
compas_fab
roslibpy
integral_timber_joints""")
reload = Button()
py = PythonScript(reload_module_button=reload, module_names=python_module_to_reload)  # inputs module_names: list
# ---------- py: Python ----------
import compas_ghpython
from compas_ghpython import unload_modules
if reload_module_button:
    for module in module_names:
        unload_modules(module)
# ---------- end py ----------

# ----
# The clamp type. Identifyable id name.
# Mesh Geometry of the parallel gripper. Base Mesh is attached to the robot (e.g. gripper body, spacer, quick changer)
# Geometry of the gripper jaw modeled at closed state. This part opens towards +pos Z direction of TCF (not T0CF).
# Geometry of the clamp jaw modeled at closed state. This part opens towards +pos Z direction of TCF (not T0CF).
# Gripper (attach clamp to timber) operation distance limit of each jaw.
# Min = Closed Position
# Max = Open Position
# Clamp (joint closure) operation distance limit of each jaw.
# Min = Closed Position
# Max = Open Position
# Tool Coordinate Frame (TCF) where the clamp is attached to the joint, in relation to T0CF
# Position where the robot (T0CF) needs to reach before picking up tool during tool change . (in relation to T0CF)
# Location (frame) where the tool (TCF) is stored (in WCF) during fabrication
# Vector for gripper to approach beam (in relation to T0CF)
# Vector for robot to detach the clamp after joint is assembled. (in relation to T0CF)
frame_curves_named_x_and_y = Curve([<curve referenced from the Rhino model> x3])
frame_curves_named_x_and_y_2 = Curve([<curve referenced from the Rhino model> x3])
frame_curves_named_x_and_y_3 = Curve([<curve referenced from the Rhino model> x3])
max_open_position_3 = Slider(40, range=0..200)
max_open_position_4 = Slider(140, range=0..200)
min_closed_position_typ_0_3 = Slider(0, range=0..200)
min_closed_position_typ_0_4 = Slider(0, range=0..200)
# Cross Lap Clamp - CL3 / CL3M
panel = Panel("CL3")
geo_6 = Geometry(<mesh referenced from the Rhino model>)
geo_7 = Geometry(<mesh referenced from the Rhino model>)
geo_8 = Geometry(<mesh referenced from the Rhino model>)
crv = Curve(<curve referenced from the Rhino model>)
explode = Explode(Curve=crv, Recursive=True)  # -> Segments, Vertices
mesh_6 = Mesh(geo_6)
mesh_7 = Mesh(geo_7)
mesh_8 = Mesh(geo_8)
end = EndPoints(Curve=explode.Segments)  # -> Start, End
frame_from_crv = FrameFromCrv(frame_curves_named_x_and_y=frame_curves_named_x_and_y)
frame_from_crv_2 = FrameFromCrv(frame_curves_named_x_and_y=frame_curves_named_x_and_y_2)
frame_from_crv_3 = FrameFromCrv(frame_curves_named_x_and_y=frame_curves_named_x_and_y_3)
vec2pt = Vector2Pt(PointA=end.Start, PointB=end.End, Unitize=False)  # -> Vector, Length
rev = Reverse(Vector=vec2pt.Vector)
vdis = VectorDisplay(Anchor=end.Start, Vector=vec2pt.Vector)
item = ListItem(List=vec2pt.Vector, Index=0, Wrap=True)  # -> Item, Item1
item_2 = ListItem(List=rev, Index=0, Wrap=True)  # -> Item, Item1
pln = Plane(frame_from_crv)
pln_2 = Plane(frame_from_crv_2)
pln_3 = Plane(frame_from_crv_3)
panel_2 = Panel(vec2pt.Vector)
vec_approach1_vector = Vector(item.Item)
vec_approach2_vector = Vector(item.Item1)
vec_detachretract1_vector = Vector(item_2.Item1)
vec_detachretract2_vector = Vector(item_2.Item)

# ----
# Parallel Gripper - PG2
# The gripper type. Identifyable id name.
# Mesh Geometry of the parallel gripper. Base Mesh is attached to the robot (e.g. gripper body, spacer, quick changer)
# Geometry of the Left Jaw modeled at closed state, this jaw open towards -neg Y direction.
# Geometry of the Right Jaw modeled at closed state, this jaw open towards +pos Y direction.
# Jaw operation distance limit of each jaw.
# Min = Closed Position
# Max = Open Position
# Tool Coordinate Frame (TCF) where the beam is held, in relation to T0CF
# Position where the robot (T0CF) needs to reach before picking up tool during tool change . (in relation to T0CF)
# Location (frame) where the tool (TCF) is stored (in WCF) during fabrication
# Vector for gripper to approach beam
xy_4 = XYPlane(Origin=Point(0, 0, 0))
geo_9 = Geometry(<mesh referenced from the Rhino model>)
geo_10 = Geometry(<mesh referenced from the Rhino model>)
geo_11 = Geometry(<mesh referenced from the Rhino model>)
max_open_position_5 = Slider(20, range=0..200)
pt_3 = Point(<point referenced from the Rhino model>)
pt_4 = Point(<point referenced from the Rhino model>)
min_closed_position_typ_0_5 = Slider(0, range=0..200)
xy_5 = XYPlane(Origin=pt_3)
xy_6 = XYPlane(Origin=pt_4)
mesh_9 = Mesh(geo_9)
mesh_10 = Mesh(geo_10)
mesh_11 = Mesh(geo_11)
Z_2 = UnitZ(Factor=Slider(105, range=0..1000))
create_parallel_gripper = GhPythonScript(
    type_name="PG2",
    base_mesh=mesh_9,
    l_jaw_mesh=mesh_10,
    r_jaw_mesh=mesh_11,
    gripper_jaw_position_min=min_closed_position_typ_0_5,
    gripper_jaw_position_max=max_open_position_5,
    tool_coordinate_frame=xy_5,
    tool_pick_up_frame=xy_6,
    tool_storage_frame=xy_4,
    approach_vector=Z_2)  # -> out, robot_model; inputs base_mesh: Mesh, l_jaw_mesh: Mesh, r_jaw_mesh: Mesh, tool_coordinate_frame: Plane, tool_pick_up_frame: Plane, tool_storage_frame: Plane, approach_vector: Vector3d
# ---------- create_parallel_gripper: Python ----------
#from compas_ghpython import unload_modules
#unload_modules("integral_timber_joints")

from compas.geometry import Frame
from compas_rhino.geometry import RhinoPlane, RhinoMesh, RhinoVector
from integral_timber_joints.tools import ParallelGripperFactory

from compas_ghpython.helpers import mesh_draw

tool_coordinate_frame = RhinoPlane.from_geometry(tool_coordinate_frame).to_compas()
tool_pick_up_frame = RhinoPlane.from_geometry(tool_pick_up_frame).to_compas()
tool_storage_frame = RhinoPlane.from_geometry(tool_storage_frame).to_compas()
mesh_gripper_base = RhinoMesh.from_geometry(base_mesh).to_compas()
mesh_gripper_jaw_l = RhinoMesh.from_geometry(l_jaw_mesh).to_compas()
mesh_gripper_jaw_r = RhinoMesh.from_geometry(r_jaw_mesh).to_compas()
approach_vector = RhinoVector.from_geometry(approach_vector).to_compas()

robot_model = ParallelGripperFactory(
    None,
    type_name,
    gripper_jaw_position_min,
    gripper_jaw_position_max,
    tool_coordinate_frame = tool_coordinate_frame,
    tool_pick_up_frame = tool_pick_up_frame,
    tool_storage_frame = tool_storage_frame,
    mesh_gripper_base = mesh_gripper_base,
    mesh_gripper_jaw_l = mesh_gripper_jaw_l,
    mesh_gripper_jaw_r = mesh_gripper_jaw_r,
    approach_vector = approach_vector,
    )
# ---------- end create_parallel_gripper ----------

# ----
# Parallel Gripper - PG1
# The gripper type. Identifyable id name.
# Mesh Geometry of the parallel gripper. Base Mesh is attached to the robot (e.g. gripper body, spacer, quick changer)
# Geometry of the Left Jaw modeled at closed state, this jaw open towards -neg Y direction.
# Geometry of the Right Jaw modeled at closed state, this jaw open towards +pos Y direction.
# Jaw operation distance limit of each jaw.
# Min = Closed Position
# Max = Open Position
# Tool Coordinate Frame (TCF) where the beam is held, in relation to T0CF
# Position where the robot (T0CF) needs to reach before picking up tool during tool change . (in relation to T0CF)
# Location (frame) where the tool (TCF) is stored (in WCF) during fabrication
# Vector for gripper to approach beam
xy_7 = XYPlane(Origin=Point(0, 0, 0))
geo_12 = Geometry(<mesh referenced from the Rhino model>)
geo_13 = Geometry(<mesh referenced from the Rhino model>)
geo_14 = Geometry(<mesh referenced from the Rhino model>)
max_open_position_6 = Slider(20, range=0..200)
pt_5 = Point(<point referenced from the Rhino model>)
pt_6 = Point(<point referenced from the Rhino model>)
min_closed_position_typ_0_6 = Slider(0, range=0..200)
xy_8 = XYPlane(Origin=pt_5)
xy_9 = XYPlane(Origin=pt_6)
mesh_12 = Mesh(geo_12)
mesh_13 = Mesh(geo_13)
mesh_14 = Mesh(geo_14)
Z_3 = UnitZ(Factor=Slider(105, range=0..1000))
create_parallel_gripper_2 = GhPythonScript(
    type_name="PG1",
    base_mesh=mesh_12,
    l_jaw_mesh=mesh_13,
    r_jaw_mesh=mesh_14,
    gripper_jaw_position_min=min_closed_position_typ_0_6,
    gripper_jaw_position_max=max_open_position_6,
    tool_coordinate_frame=xy_8,
    tool_pick_up_frame=xy_9,
    tool_storage_frame=xy_7,
    approach_vector=Z_3)  # -> out, robot_model; inputs base_mesh: Mesh, l_jaw_mesh: Mesh, r_jaw_mesh: Mesh, tool_coordinate_frame: Plane, tool_pick_up_frame: Plane, tool_storage_frame: Plane, approach_vector: Vector3d
# ---------- create_parallel_gripper_2: Python ----------
#from compas_ghpython import unload_modules
#unload_modules("integral_timber_joints")

from compas.geometry import Frame, Vector, Box
from compas.datastructures import Mesh

from compas_rhino.geometry import RhinoPlane, RhinoMesh, RhinoVector
from integral_timber_joints.tools import ParallelGripperFactory

from compas_ghpython.helpers import mesh_draw

tool_coordinate_frame = RhinoPlane.from_geometry(tool_coordinate_frame).to_compas()
tool_pick_up_frame = RhinoPlane.from_geometry(tool_pick_up_frame).to_compas()
tool_storage_frame = RhinoPlane.from_geometry(tool_storage_frame).to_compas()
mesh_gripper_base = RhinoMesh.from_geometry(base_mesh).to_compas()
mesh_gripper_jaw_l = RhinoMesh.from_geometry(l_jaw_mesh).to_compas()
mesh_gripper_jaw_r = RhinoMesh.from_geometry(r_jaw_mesh).to_compas()
approach_vector = RhinoVector.from_geometry(approach_vector).to_compas()

robot_model = ParallelGripperFactory(
    None,
    type_name,
    gripper_jaw_position_min,
    gripper_jaw_position_max,
    tool_coordinate_frame = tool_coordinate_frame,
    tool_pick_up_frame = tool_pick_up_frame,
    tool_storage_frame = tool_storage_frame,
    mesh_gripper_base = mesh_gripper_base,
    mesh_gripper_jaw_l = mesh_gripper_jaw_l,
    mesh_gripper_jaw_r = mesh_gripper_jaw_r,
    approach_vector = approach_vector,
    )
# ---------- end create_parallel_gripper_2 ----------

# ----
# Check Path and Environment
compas_version = GhPythonScript()  # -> out, compas_version, compas_fab_version, compas_path, compas_fab_path, compas_env_name, python_directory
# ---------- compas_version: Python ----------
__author__ = "leungp"
__version__ = "2020.04.20"

import rhinoscriptsyntax as rs
import compas
import compas_fab
compas_version  = compas.__version__
compas_fab_version = compas_fab.__version__
import os
compas_path = os.path.abspath(compas.__file__)
compas_fab_path = os.path.abspath(compas_fab.__file__)

import compas_bootstrapper
compas_env_name = compas_bootstrapper.ENVIRONMENT_NAME
python_directory = compas_bootstrapper.PYTHON_DIRECTORY
# ---------- end compas_version ----------
compas_environment_name = Panel(compas_version.compas_env_name)
compas_version_2 = Panel(compas_version.compas_version)
compas_fab_version = Panel(compas_version.compas_fab_version)
compas_path = Panel(compas_version.compas_path)
compas_fab_path = Panel(compas_version.compas_fab_path)
python_directory = Panel(compas_version.python_directory)

crv_2 = Curve([<curve referenced from the Rhino model> x4])

mirror_plane_flip_y = MirrorPlaneFlipY(G=pln)
mirror = Mirror(Geometry=mesh_8, Plane=PlaneYZ(0, 0, 0))  # -> Geometry, Transform
mirror_2 = Mirror(Geometry=mesh_7, Plane=PlaneYZ(0, 0, 0))  # -> Geometry, Transform
mirror_3 = Mirror(Geometry=mesh_6, Plane=PlaneYZ(0, 0, 0))  # -> Geometry, Transform
frame_curves_named_x_and_y_4 = Curve([<curve referenced from the Rhino model> x4])
pln_4 = Plane(pln_2)
mirror_4 = Mirror(Geometry=vec_approach1_vector, Plane=PlaneYZ(0, 0, 0))  # -> Geometry, Transform
mirror_5 = Mirror(Geometry=vec_approach2_vector, Plane=PlaneYZ(0, 0, 0))  # -> Geometry, Transform
mirror_6 = Mirror(Geometry=vec_detachretract1_vector, Plane=PlaneYZ(0, 0, 0))  # -> Geometry, Transform
mirror_7 = Mirror(Geometry=vec_detachretract2_vector, Plane=PlaneYZ(0, 0, 0))  # -> Geometry, Transform
frame_from_crv_4 = FrameFromCrv(frame_curves_named_x_and_y=frame_curves_named_x_and_y_4)

# ----
# Test Motion
# Test Full Stroke Movement
_0_0_to_1_0_relative_position = Slider(0, range=0..1)
deepcopy = GhPythonScript(data_in=create_parallel_gripper_2.robot_model)  # -> data_out
# ---------- deepcopy: Python ----------
from copy import deepcopy
data_out = deepcopy(data_in)
# ---------- end deepcopy ----------
set_clamp_state = GhPythonScript(robot_model=deepcopy, gripper_jaw_position_relative=_0_0_to_1_0_relative_position)  # -> out, robot_model_out
# ---------- set_clamp_state: Python ----------
from integral_timber_joints.ghpython.utilities import rPlane2cFrame
from compas_rhino.geometry import RhinoPlane

# Deep copy should be performed before this script
robot_model_out = robot_model

# Set State
if hasattr(robot_model_out,"gripper_jaw_limits"):
    limits = robot_model_out.gripper_jaw_limits
    robot_model_out.gripper_jaw_position = gripper_jaw_position_relative * (limits[1]-limits[0]) + limits[0]
    print (robot_model_out.gripper_jaw_position)
    
if hasattr(robot_model_out,"clamp_jaw_limits"):
    limits = robot_model_out.clamp_jaw_limits
    robot_model_out.clamp_jaw_position = clamp_jaw_position_relative * (limits[1]-limits[0]) + limits[0]
# ---------- end set_clamp_state ----------
robot_artist = GhPythonScript(robot_model=set_clamp_state.robot_model_out)  # -> out, visual
# ---------- robot_artist: Python ----------
from compas_ghpython.helpers import mesh_draw
visual = [mesh_draw(mesh) for mesh in robot_model.draw_visuals()]
# ---------- end robot_artist ----------

# ----
# Test Motion
# Test Full Stroke Movement
_0_0_to_1_0_relative_position_2 = Slider(0, range=0..1)  # disabled
set_clamp_state_2 = GhPythonScript(robot_model=create_parallel_gripper.robot_model, gripper_jaw_position_relative=_0_0_to_1_0_relative_position_2)  # -> out, robot_model_out; disabled
# ---------- set_clamp_state_2: Python ----------
from integral_timber_joints.ghpython.utilities import rPlane2cFrame
from compas_rhino.geometry import RhinoPlane

# Deep copy should be performed before editing
robot_model_out = robot_model.copy()

# Set State
if hasattr(robot_model_out,"gripper_jaw_limits"):
    limits = robot_model_out.gripper_jaw_limits
    robot_model_out.gripper_jaw_position = gripper_jaw_position_relative * (limits[1]-limits[0]) + limits[0]

if hasattr(robot_model_out,"clamp_jaw_limits"):
    limits = robot_model_out.clamp_jaw_limits
    robot_model_out.clamp_jaw_position = clamp_jaw_position_relative * (limits[1]-limits[0]) + limits[0]
# ---------- end set_clamp_state_2 ----------
robot_artist_2 = GhPythonScript(robot_model=set_clamp_state_2.robot_model_out)  # -> out, visual; disabled; same code as robot_artist

# ----
# Test Motion
# Test Full Stroke Movement
_0_0_to_1_0_relative_position_3 = Slider(0, range=0..1)  # disabled
_0_0_to_1_0_relative_position_4 = Slider(1, range=0..1)  # disabled
set_clamp_state_3 = GhPythonScript(
    robot_model=create_clamp.robot_model,
    gripper_jaw_position_relative=_0_0_to_1_0_relative_position_3,
    clamp_jaw_position_relative=_0_0_to_1_0_relative_position_4)  # -> out, robot_model_out; disabled; same code as set_clamp_state_2
robot_artist_3 = GhPythonScript(robot_model=set_clamp_state_3.robot_model_out)  # -> out, visual; disabled; same code as robot_artist

mirror_8 = Mirror(Geometry=crv_2, Plane=PlaneYZ(0, 0, 0))  # -> Geometry, Transform

# ----
# Save
# Save location next to Rhino File
# Fle name = tool_name.pickle
auto_path = GhPythonScript(tool_name="PG1")  # -> json_path, pickle_path
# ---------- auto_path: Python ----------
from Rhino.RhinoDoc import ActiveDoc
import os
json_path = os.path.split(ActiveDoc.Path)[0] + os.path.sep + tool_name +".json"
pickle_path = os.path.split(ActiveDoc.Path)[0] + os.path.sep + tool_name +".pickle"
# ---------- end auto_path ----------
save = Button()  # disabled
python = GhPythonScript(robot_model=create_parallel_gripper_2.robot_model, pickle_path=auto_path.pickle_path, output=save)  # -> out, a; disabled
# ---------- python: Python ----------
if output:
    import pickle
    with open(pickle_path, 'wb') as f:
        pickle.dump(robot_model, f, protocol = 2)
# ---------- end python ----------

# ----
# Save
# Save location next to Rhino File
# Fle name = tool_name.pickle
auto_path_2 = GhPythonScript(tool_name="PG2")  # -> json_path, pickle_path; same code as auto_path
save_2 = Button()
python_2 = GhPythonScript(robot_model=create_parallel_gripper.robot_model, json_path=auto_path_2.json_path, output=save_2)  # -> out, a
# ---------- python_2: Python ----------
if output:
    import jsonpickle
    with open(json_path, 'w') as f:
        f.write(jsonpickle.encode(robot_model, keys=True))
# ---------- end python_2 ----------

save_3 = Button()

# ----
# Save
# Save location next to Rhino File
# Fle name = tool_name.pickle
auto_path_3 = GhPythonScript(tool_name="CL1")  # -> json_path, pickle_path; same code as auto_path
save_4 = Button()
python_3 = GhPythonScript(robot_model=create_clamp.robot_model, json_path=auto_path_3.json_path, output=save_4)  # -> out, a; same code as python_2

python_4 = GhPythonScript(robot_model=create_parallel_gripper_2.robot_model, json_path=auto_path.json_path, output=save_3)  # -> out, a; same code as python_2
pln_5 = Plane(frame_from_crv_4)
create_clamp_2 = GhPythonScript(
    type_name=panel,
    base_mesh=mesh_6,
    gripper_jaw_mesh=mesh_8,
    clamp_jaw_mesh=mesh_7,
    gripper_jaw_position_min=min_closed_position_typ_0_3,
    gripper_jaw_position_max=max_open_position_3,
    clamp_jaw_position_min=min_closed_position_typ_0_4,
    clamp_jaw_position_max=max_open_position_4,
    tool_coordinate_frame=pln,
    tool_pick_up_frame=pln_2,
    tool_storage_frame=pln_3,
    approach1_vector=vec_approach1_vector,
    approach2_vector=vec_approach2_vector,
    detachretract1_vector=vec_detachretract1_vector,
    detachretract2_vector=vec_detachretract2_vector,
    gripper_drill_lines=crv_2)  # -> out, visual, robot_model; inputs base_mesh: Mesh, gripper_jaw_mesh: Mesh, clamp_jaw_mesh: Mesh, tool_coordinate_frame: Plane, tool_pick_up_frame: Plane, tool_storage_frame: Plane, approach1_vector: Vector3d, approach2_vector: Vector3d, detachretract1_vector: Vector3d, detachretract2_vector: Vector3d, gripper_drill_lines: list of Line
# ---------- create_clamp_2: Python ----------
#from compas_ghpython import unload_modules
#unload_modules("integral_timber_joints")

from compas.geometry import Frame, Vector
from compas_rhino.geometry import RhinoPlane, RhinoMesh, RhinoVector, RhinoLine
from integral_timber_joints.tools import CL3Factory

from compas_ghpython.helpers import mesh_draw

tool_coordinate_frame = RhinoPlane.from_geometry(tool_coordinate_frame).to_compas()
tool_pick_up_frame = RhinoPlane.from_geometry(tool_pick_up_frame).to_compas()
tool_storage_frame = RhinoPlane.from_geometry(tool_storage_frame).to_compas()
base_mesh = RhinoMesh.from_geometry(base_mesh).to_compas()
gripper_jaw_mesh = RhinoMesh.from_geometry(gripper_jaw_mesh).to_compas()
clamp_jaw_mesh = RhinoMesh.from_geometry(clamp_jaw_mesh).to_compas()
approach1_vector = RhinoVector.from_geometry(approach1_vector).to_compas()
approach2_vector = RhinoVector.from_geometry(approach2_vector).to_compas()
detachretract1_vector = RhinoVector.from_geometry(detachretract1_vector).to_compas()
detachretract2_vector = RhinoVector.from_geometry(detachretract2_vector).to_compas()
gripper_drill_lines = [RhinoLine.from_geometry(crv).to_compas() for crv in gripper_drill_lines]
    
robot_model = CL3Factory(
    None,
    type_name,
    gripper_jaw_position_min,
    gripper_jaw_position_max,
    clamp_jaw_position_min,
    clamp_jaw_position_max,
    tool_coordinate_frame = tool_coordinate_frame,
    tool_pick_up_frame = tool_pick_up_frame,
    tool_storage_frame = tool_storage_frame,
    base_mesh = base_mesh,
    gripper_jaw_mesh = gripper_jaw_mesh,
    clamp_jaw_mesh = clamp_jaw_mesh,
    approach1_vector = approach1_vector,
    approach2_vector = approach2_vector,
    detachretract1_vector = detachretract1_vector,
    detachretract2_vector = detachretract2_vector,
    gripper_drill_lines = gripper_drill_lines
    )
# ---------- end create_clamp_2 ----------
create_clamp_3 = GhPythonScript(
    type_name="CL3M",
    base_mesh=mirror_3.Geometry,
    gripper_jaw_mesh=mirror.Geometry,
    clamp_jaw_mesh=mirror_2.Geometry,
    gripper_jaw_position_min=min_closed_position_typ_0_3,
    gripper_jaw_position_max=max_open_position_3,
    clamp_jaw_position_min=min_closed_position_typ_0_4,
    clamp_jaw_position_max=max_open_position_4,
    tool_coordinate_frame=mirror_plane_flip_y,
    tool_pick_up_frame=pln_4,
    tool_storage_frame=pln_5,
    approach1_vector=mirror_4.Geometry,
    approach2_vector=mirror_5.Geometry,
    detachretract1_vector=mirror_6.Geometry,
    detachretract2_vector=mirror_7.Geometry,
    gripper_drill_lines=mirror_8.Geometry)  # -> out, visual, robot_model; inputs base_mesh: Mesh, gripper_jaw_mesh: Mesh, clamp_jaw_mesh: Mesh, tool_coordinate_frame: Plane, tool_pick_up_frame: Plane, tool_storage_frame: Plane, approach1_vector: Vector3d, approach2_vector: Vector3d, detachretract1_vector: Vector3d, detachretract2_vector: Vector3d, gripper_drill_lines: list of Line; same code as create_clamp_2

load_tool = GhPythonScript(pickle_path=auto_path.pickle_path)  # -> out, tool; disabled
# ---------- load_tool: Python ----------
import pickle
with open(pickle_path, 'rb') as f:
    tool = pickle.load(f)
# ---------- end load_tool ----------
python_5 = GhPythonScript(tool=load_tool.tool)  # -> out, links; disabled
# ---------- python_5: Python ----------
links = [link.name for link in tool.links]
# ---------- end python_5 ----------
panel_3 = Panel(python_5.links)  # disabled

load_tool_2 = GhPythonScript(json_path=auto_path.json_path)  # -> out, tool
# ---------- load_tool_2: Python ----------
import jsonpickle
with open(json_path, 'r') as f:
    tool = jsonpickle.decode(f.read(), keys=True)
# ---------- end load_tool_2 ----------
python_6 = GhPythonScript(tool=load_tool_2.tool)  # -> out, links; same code as python_5
panel_4 = Panel(python_6.links)

# ----
# Save
# Save location next to Rhino File
# Fle name = tool_name.pickle
auto_path_4 = GhPythonScript(tool_name=panel)  # -> json_path, pickle_path; same code as auto_path
save_5 = Button()
python_7 = GhPythonScript(robot_model=create_clamp_2.robot_model, json_path=auto_path_4.json_path, output=save_5)  # -> out, json_path; same code as python_2

load_tool_3 = GhPythonScript(json_path=auto_path_3.json_path, x=save_4)  # -> out, tool; same code as load_tool_2
python_8 = GhPythonScript(tool=load_tool_3.tool)  # -> out, links; same code as python_5
panel_5 = Panel(python_8.links)

# ----
# Save
# Save location next to Rhino File
# Fle name = tool_name.pickle
auto_path_5 = GhPythonScript(tool_name="CL3M")  # -> json_path, pickle_path; same code as auto_path
save_6 = Button()
python_9 = GhPythonScript(robot_model=create_clamp_3.robot_model, json_path=auto_path_5.json_path, output=save_6)  # -> out, json_path; same code as python_2

load_tool_4 = GhPythonScript(json_path=python_7.json_path, x=save_5)  # -> out, tool; same code as load_tool_2
python_10 = GhPythonScript(tool=load_tool_4.tool)  # -> out, links; same code as python_5
panel_6 = Panel(python_10.links)

# ----
# Test Motion
# Test Full Stroke Movement
_0_0_to_1_0_relative_position_5 = Slider(0, range=0..1)
_0_0_to_1_0_relative_position_6 = Slider(1, range=0..1)
set_clamp_state_4 = GhPythonScript(
    robot_model=load_tool_4.tool,
    gripper_jaw_position_relative=_0_0_to_1_0_relative_position_5,
    clamp_jaw_position_relative=_0_0_to_1_0_relative_position_6)  # -> out, robot_model_out, frames_in_wcf
# ---------- set_clamp_state_4: Python ----------
from integral_timber_joints.ghpython.utilities import rPlane2cFrame
from compas_rhino.geometry import RhinoPlane

# Deep copy should be performed before editing
robot_model_out = robot_model.copy()
robot_model = None

# Set State
#robot_model_out.current_frame = robot_model_out.tool_storage_frame.copy()
robot_model_out.set_current_frame_from_tcp(robot_model_out.tool_storage_frame.copy())

if hasattr(robot_model_out,"gripper_jaw_limits"):
    limits = robot_model_out.gripper_jaw_limits
    robot_model_out.gripper_jaw_position = gripper_jaw_position_relative * (limits[1]-limits[0]) + limits[0]

if hasattr(robot_model_out,"clamp_jaw_limits"):
    limits = robot_model_out.clamp_jaw_limits
    robot_model_out.clamp_jaw_position = clamp_jaw_position_relative * (limits[1]-limits[0]) + limits[0]
    
from compas_ghpython import draw_frame
frames_in_wcf = []
frames_in_wcf.append(draw_frame(robot_model_out.current_frame))
frames_in_wcf.append(draw_frame(robot_model_out.tool_pick_up_frame_in_wcf(robot_model_out.current_frame)))
frames_in_wcf.append(draw_frame(robot_model_out.tool_coordinate_frame_in_wcf(robot_model_out.current_frame)))
# ---------- end set_clamp_state_4 ----------
robot_artist_4 = GhPythonScript(robot_model=set_clamp_state_4.robot_model_out)  # -> out, visual; same code as robot_artist

frame_curves_named_x_and_y_5 = Curve([<curve referenced from the Rhino model> x3])
frame_curves_named_x_and_y_6 = Curve([<curve referenced from the Rhino model> x3])
frame_curves_named_x_and_y_7 = Curve([<curve referenced from the Rhino model> x3])
# Closing Direction of Left Jaw
X = UnitX(Factor=1)
frame_curves_named_x_and_y_8 = Curve([<curve referenced from the Rhino model> x3])
frame_curves_named_x_and_y_9 = Curve([<curve referenced from the Rhino model> x3])
frame_curves_named_x_and_y_10 = Curve([<curve referenced from the Rhino model> x3])
# Closing Direction of Left Jaw
X_2 = UnitX(Factor=1)

load_tool_5 = GhPythonScript(json_path=python_9.json_path, x=save_6)  # -> out, tool; same code as load_tool_2
python_11 = GhPythonScript(tool=load_tool_5.tool)  # -> out, links; same code as python_5
panel_7 = Panel(python_11.links)

# ----
# Test Motion
# Test Full Stroke Movement
_0_0_to_1_0_relative_position_7 = Slider(0, range=0..1)
_0_0_to_1_0_relative_position_8 = Slider(1, range=0..1)
set_clamp_state_5 = GhPythonScript(
    robot_model=load_tool_5.tool,
    gripper_jaw_position_relative=_0_0_to_1_0_relative_position_7,
    clamp_jaw_position_relative=_0_0_to_1_0_relative_position_8)  # -> out, robot_model_out, frames_in_wcf; same code as set_clamp_state_4
robot_artist_5 = GhPythonScript(robot_model=set_clamp_state_5.robot_model_out)  # -> out, visual; same code as robot_artist

# ----
# Robot Wrist Collision Mesh - ROB_WRIST
# Robot Wrist Collision Mesh
# 
# This is a simple mesh that represent Robot Wrist for quick collision detection during Process Design
# Name for saving file
# Mesh Geometry of the robot wrist.
panel_8 = Panel("ROB_WRIST")
mesh_15 = Mesh([<mesh referenced from the Rhino model> x2])
create_robotwrist = GhPythonScript(rhino_meshes=mesh_15)  # -> out, robotwrist; inputs rhino_meshes: list of Mesh
# ---------- create_robotwrist: Python ----------
from compas.datastructures import Mesh

from compas_rhino.geometry import RhinoMesh
from integral_timber_joints.tools.robot_wrist import RobotWrist

compas_meshes = [RhinoMesh.from_geometry(rhino_mesh).to_compas() for rhino_mesh in rhino_meshes]

robotwrist = RobotWrist(compas_meshes)
# ---------- end create_robotwrist ----------

# ----
# ToolChanger - TC1
# Model the tool changer such that the model at the orgin will be attach to the robot flange.
# 
# Tool changer is a subclass of Tool, however only one instance exist in a given Process. Therefor the name and type_name is the same to simplify things.
# Identifyable name for the tool changer
# Mesh Geometry of the parallel gripper. Base Mesh is attached to the robot (e.g. gripper body, spacer, quick changer)
# Tool Coodinate Frame -
# The tool will attach to this point.
panel_9 = Panel("TC1")
mesh_16 = Mesh(<mesh referenced from the Rhino model>)
frame_curves_named_x_and_y_11 = Curve([<curve referenced from the Rhino model> x3])
frame_from_crv_5 = FrameFromCrv(frame_curves_named_x_and_y=frame_curves_named_x_and_y_11)
pln_6 = Plane(frame_from_crv_5)
create_toolchanger = GhPythonScript(type_name=panel_9, base_mesh=mesh_16, tool_coordinate_frame=pln_6)  # -> out, robot_model; inputs base_mesh: Mesh, tool_coordinate_frame: Plane
# ---------- create_toolchanger: Python ----------
#from compas_ghpython import unload_modules
#unload_modules("integral_timber_joints")

from compas.geometry import Frame, Vector, Box
from compas.datastructures import Mesh

from compas_rhino.geometry import RhinoPlane, RhinoMesh, RhinoVector
from integral_timber_joints.tools import ToolChanger

from compas_ghpython.helpers import mesh_draw

tool_coordinate_frame = RhinoPlane.from_geometry(tool_coordinate_frame).to_compas()
base_mesh = RhinoMesh.from_geometry(base_mesh).to_compas()

robot_model = ToolChanger(name = type_name,
                          tool_coordinate_frame = tool_coordinate_frame,
                          collision_mesh = base_mesh,
                          type_name = type_name)
# ---------- end create_toolchanger ----------

# ----
# ToolChanger - TC2 (With IGPS Flange)
# Identifyable name for the tool changer
# Mesh Geometry of the parallel gripper. Base Mesh is attached to the robot (e.g. gripper body, spacer, quick changer)
# Tool Coodinate Frame -
# The tool will attach to this point.
frame_curves_named_x_and_y_12 = Curve([<curve referenced from the Rhino model> x3])
mesh_17 = Mesh(<mesh referenced from the Rhino model>)
frame_from_crv_6 = FrameFromCrv(frame_curves_named_x_and_y=frame_curves_named_x_and_y_12)
pln_7 = Plane(frame_from_crv_6)
create_toolchanger_2 = GhPythonScript(type_name="TC2", base_mesh=mesh_17, tool_coordinate_frame=pln_7)  # -> out, robot_model; inputs base_mesh: Mesh, tool_coordinate_frame: Plane; same code as create_toolchanger

frame_from_crv_7 = FrameFromCrv(frame_curves_named_x_and_y=frame_curves_named_x_and_y_5)
frame_from_crv_8 = FrameFromCrv(frame_curves_named_x_and_y=frame_curves_named_x_and_y_6)
frame_from_crv_9 = FrameFromCrv(frame_curves_named_x_and_y=frame_curves_named_x_and_y_7)
frame_from_crv_10 = FrameFromCrv(frame_curves_named_x_and_y=frame_curves_named_x_and_y_8)
frame_from_crv_11 = FrameFromCrv(frame_curves_named_x_and_y=frame_curves_named_x_and_y_9)
frame_from_crv_12 = FrameFromCrv(frame_curves_named_x_and_y=frame_curves_named_x_and_y_10)
rev_2 = Reverse(Vector=X)
rev_3 = Reverse(Vector=X_2)
pln_8 = Plane(frame_from_crv_7)
pln_9 = Plane(frame_from_crv_8)
pln_10 = Plane(frame_from_crv_9)

# ----
# Parallel Gripper - PG1000
# The gripper type. Identifyable id name.
# Mesh Geometry of the parallel gripper. Base Mesh is attached to the robot (e.g. gripper body, spacer, quick changer)
# Geometry of the Left Jaw modeled at closed state, this jaw open towards -neg Y direction.
# Geometry of the Right Jaw modeled at closed state, this jaw open towards +pos Y direction.
# Jaw operation distance limit of each jaw.
# Min = Closed Position
# Max = Open Position
# Tool Coordinate Frame (TCF) where the beam is held, in relation to T0CF
# Position where the robot (T0CF) needs to reach before picking up tool during tool change . (in relation to T0CF)
# Location (frame) where the tool (TCF) is stored (in WCF) during fabrication
# Vector for gripper to approach beam
number_slider = Slider(105, range=0..1000)
min_closed_position_typ_0_7 = Slider(0.8, range=0..200)
max_open_position_7 = Slider(10, range=0..200)
mesh_18 = Mesh(<mesh referenced from the Rhino model>)
mesh_19 = Mesh([<mesh referenced from the Rhino model> x2])
mesh_20 = Mesh([<mesh referenced from the Rhino model> x2])
Z_4 = UnitZ(Factor=number_slider)
create_multifinger_parallel_gripper = GhPythonScript(
    type_name="PG1000",
    base_mesh=mesh_18,
    l_jaw_meshes=mesh_20,
    r_jaw_meshes=mesh_19,
    gripper_jaw_position_min=min_closed_position_typ_0_7,
    gripper_jaw_position_max=max_open_position_7,
    tool_coordinate_frame=pln_8,
    tool_pick_up_frame=pln_9,
    tool_storage_frame=pln_10,
    jaw_vector_l=X,
    jaw_vector_r=rev_2,
    approach_vector=Z_4)  # -> out, robot_model; inputs base_mesh: Mesh, l_jaw_meshes: list of Mesh, r_jaw_meshes: list of Mesh, tool_coordinate_frame: Plane, tool_pick_up_frame: Plane, tool_storage_frame: Plane, jaw_vector_l: Vector3d, jaw_vector_r: Vector3d, approach_vector: Vector3d
# ---------- create_multifinger_parallel_gripper: Python ----------
#from compas_ghpython import unload_modules
#unload_modules("integral_timber_joints")

from compas.geometry import Frame, Vector, Box
from compas.datastructures import Mesh

from compas_rhino.geometry import RhinoPlane, RhinoMesh, RhinoVector
from integral_timber_joints.tools import MultiFingerParallelGripperFactory

from compas_ghpython.helpers import mesh_draw

tool_coordinate_frame = RhinoPlane.from_geometry(tool_coordinate_frame).to_compas()
tool_pick_up_frame = RhinoPlane.from_geometry(tool_pick_up_frame).to_compas()
tool_storage_frame = RhinoPlane.from_geometry(tool_storage_frame).to_compas()
mesh_gripper_base = RhinoMesh.from_geometry(base_mesh).to_compas()
meshes_gripper_jaw_l = [RhinoMesh.from_geometry(m).to_compas() for m in l_jaw_meshes]
meshes_gripper_jaw_r = [RhinoMesh.from_geometry(m).to_compas() for m in r_jaw_meshes]
jaw_vector_l = RhinoVector.from_geometry(jaw_vector_l).to_compas()
jaw_vector_r = RhinoVector.from_geometry(jaw_vector_r).to_compas()
approach_vector = RhinoVector.from_geometry(approach_vector).to_compas()

robot_model = MultiFingerParallelGripperFactory(
    None,
    type_name,
    gripper_jaw_position_min,
    gripper_jaw_position_max,
    tool_coordinate_frame = tool_coordinate_frame,
    tool_pick_up_frame = tool_pick_up_frame,
    tool_storage_frame = tool_storage_frame,
    mesh_gripper_base = mesh_gripper_base,
    meshes_gripper_jaw_l = meshes_gripper_jaw_l,
    meshes_gripper_jaw_r = meshes_gripper_jaw_r,
    jaw_vector_l = jaw_vector_l,
    jaw_vector_r = jaw_vector_r,
    approach_vector = approach_vector,
    )
# ---------- end create_multifinger_parallel_gripper ----------

pln_11 = Plane(frame_from_crv_10)
pln_12 = Plane(frame_from_crv_11)
pln_13 = Plane(frame_from_crv_12)

# ----
# Parallel Gripper - PG500
# The gripper type. Identifyable id name.
# Mesh Geometry of the parallel gripper. Base Mesh is attached to the robot (e.g. gripper body, spacer, quick changer)
# Geometry of the Left Jaw modeled at closed state, this jaw open towards -neg Y direction.
# Geometry of the Right Jaw modeled at closed state, this jaw open towards +pos Y direction.
# Jaw operation distance limit of each jaw.
# Min = Closed Position
# Max = Open Position
# Tool Coordinate Frame (TCF) where the beam is held, in relation to T0CF
# Position where the robot (T0CF) needs to reach before picking up tool during tool change . (in relation to T0CF)
# Location (frame) where the tool (TCF) is stored (in WCF) during fabrication
# Vector for gripper to approach beam
number_slider_2 = Slider(105, range=0..1000)
min_closed_position_typ_0_8 = Slider(0.8, range=0..200)
max_open_position_8 = Slider(10, range=0..200)
mesh_21 = Mesh(<mesh referenced from the Rhino model>)
mesh_22 = Mesh([<mesh referenced from the Rhino model> x2])
mesh_23 = Mesh([<mesh referenced from the Rhino model> x2])
Z_5 = UnitZ(Factor=number_slider_2)
create_multifinger_parallel_gripper_2 = GhPythonScript(
    type_name="PG500",
    base_mesh=mesh_21,
    l_jaw_meshes=mesh_23,
    r_jaw_meshes=mesh_22,
    gripper_jaw_position_min=min_closed_position_typ_0_8,
    gripper_jaw_position_max=max_open_position_8,
    tool_coordinate_frame=pln_11,
    tool_pick_up_frame=pln_12,
    tool_storage_frame=pln_13,
    jaw_vector_l=X_2,
    jaw_vector_r=rev_3,
    approach_vector=Z_5)  # -> out, robot_model; inputs base_mesh: Mesh, l_jaw_meshes: list of Mesh, r_jaw_meshes: list of Mesh, tool_coordinate_frame: Plane, tool_pick_up_frame: Plane, tool_storage_frame: Plane, jaw_vector_l: Vector3d, jaw_vector_r: Vector3d, approach_vector: Vector3d; same code as create_multifinger_parallel_gripper

# ----
# Test Motion
# Test Full Stroke Movement
_0_0_to_1_0_relative_position_9 = Slider(0, range=0..1)
deepcopy_2 = GhPythonScript(data_in=create_multifinger_parallel_gripper_2.robot_model)  # -> data_out; same code as deepcopy
set_clamp_state_6 = GhPythonScript(robot_model=deepcopy_2, gripper_jaw_position_relative=_0_0_to_1_0_relative_position_9)  # -> out, robot_model_out, frames_in_wcf; same code as set_clamp_state_4
robot_artist_6 = GhPythonScript(robot_model=set_clamp_state_6.robot_model_out)  # -> out, visual; same code as robot_artist

# ----
# Save
# Save location next to Rhino File
# Fle name = tool_name.pickle
auto_path_6 = GhPythonScript(tool_name=panel_8)  # -> json_path, pickle_path; same code as auto_path
save_7 = Button()
python_12 = GhPythonScript(robot_model=create_robotwrist.robotwrist, json_path=auto_path_6.json_path, output=save_7)  # -> out, a; same code as python_2

# ----
# Save
# Save location next to Rhino File
# Fle name = tool_name.pickle
auto_path_7 = GhPythonScript(tool_name=panel_9)  # -> json_path, pickle_path; same code as auto_path
save_8 = Button()
python_13 = GhPythonScript(robot_model=create_toolchanger.robot_model, json_path=auto_path_7.json_path, output=save_8)  # -> out, a; same code as python_2

# ----
# Save
# Save location next to Rhino File
# Fle name = tool_name.pickle
auto_path_8 = GhPythonScript(tool_name="TC2")  # -> json_path, pickle_path; same code as auto_path
save_9 = Button()
python_14 = GhPythonScript(robot_model=create_toolchanger_2.robot_model, json_path=auto_path_8.json_path, output=save_9)  # -> out, a; same code as python_2

# ----
# Save
# Save location next to Rhino File
# Fle name = tool_name.pickle
auto_path_9 = GhPythonScript(tool_name="PG500")  # -> json_path, pickle_path; same code as auto_path
save_10 = Button()  # disabled
python_15 = GhPythonScript(robot_model=create_multifinger_parallel_gripper_2.robot_model, pickle_path=auto_path_9.pickle_path, output=save_10)  # -> out, a; disabled; same code as python

save_11 = Button()

# ----
# Test Motion
# Test Full Stroke Movement
_0_0_to_1_0_relative_position_10 = Slider(0, range=0..1)
deepcopy_3 = GhPythonScript(data_in=create_multifinger_parallel_gripper.robot_model)  # -> data_out; same code as deepcopy
set_clamp_state_7 = GhPythonScript(robot_model=deepcopy_3, gripper_jaw_position_relative=_0_0_to_1_0_relative_position_10)  # -> out, robot_model_out, frames_in_wcf; same code as set_clamp_state_4
robot_artist_7 = GhPythonScript(robot_model=set_clamp_state_7.robot_model_out)  # -> out, visual; same code as robot_artist

# ----
# Save
# Save location next to Rhino File
# Fle name = tool_name.pickle
auto_path_10 = GhPythonScript(tool_name="PG1000")  # -> json_path, pickle_path; same code as auto_path
save_12 = Button()  # disabled
python_16 = GhPythonScript(robot_model=create_multifinger_parallel_gripper.robot_model, pickle_path=auto_path_10.pickle_path, output=save_12)  # -> out, a; disabled; same code as python

python_17 = GhPythonScript(robot_model=create_multifinger_parallel_gripper_2.robot_model, json_path=auto_path_9.json_path, output=save_11)  # -> out, a; same code as python_2
save_13 = Button()
python_18 = GhPythonScript(robot_model=create_multifinger_parallel_gripper.robot_model, json_path=auto_path_10.json_path, output=save_13)  # -> out, a; same code as python_2

load_tool_6 = GhPythonScript(pickle_path=auto_path_9.pickle_path)  # -> out, tool; disabled; same code as load_tool
python_19 = GhPythonScript(tool=load_tool_6.tool)  # -> out, links; disabled; same code as python_5
panel_10 = Panel(python_19.links)  # disabled

load_tool_7 = GhPythonScript(json_path=auto_path_9.json_path)  # -> out, tool; same code as load_tool_2
python_20 = GhPythonScript(tool=load_tool_7.tool)  # -> out, links; same code as python_5
panel_11 = Panel(python_20.links)

load_tool_8 = GhPythonScript(pickle_path=auto_path_10.pickle_path)  # -> out, tool; disabled; same code as load_tool
python_21 = GhPythonScript(tool=load_tool_8.tool)  # -> out, links; disabled; same code as python_5
panel_12 = Panel(python_21.links)  # disabled

load_tool_9 = GhPythonScript(json_path=auto_path_10.json_path)  # -> out, tool; same code as load_tool_2
python_22 = GhPythonScript(tool=load_tool_9.tool)  # -> out, links; same code as python_5
panel_13 = Panel(python_22.links)

# ==== cluster FrameFromCrv
frame_curves_named_x_and_y = ClusterInput()
frame_curves_named_x_and_y_2 = Curve(frame_curves_named_x_and_y)
filtername = FilterByName(Geometry=frame_curves_named_x_and_y_2, Name="y")
filtername_2 = FilterByName(Geometry=frame_curves_named_x_and_y_2, Name="x")
end = EndPoints(Curve=filtername_2)  # -> Start, End
end_2 = EndPoints(Curve=filtername)  # -> Start, End
pl_3pt = Plane3Pt(PointA=end.Start, PointB=end.End, PointC=end_2.End)
pl = ClusterOutput(pl_3pt)

# ==== cluster MirrorPlaneFlipY
G = ClusterInput()
mirror = Mirror(Geometry=G, Plane=PlaneYZ(0, 0, 0))  # -> Geometry, Transform
deplane = DeconstructPlane(Plane=mirror.Geometry)  # -> Origin, XAxis, YAxis, ZAxis
rev = Reverse(Vector=deplane.YAxis)
pl = ConstructPlane(Origin=deplane.Origin, XAxis=deplane.XAxis, YAxis=rev)
pl_2 = ClusterOutput(pl)
